# Grasshopper definition FM-SampleFile.gh (Grasshopper 1.0.7)
# plug-ins: Human

dpipeline = DynamicGeometryPipeline(
    LayerFilter="input",
    TypeFilter=["Extrusion", "Brep"],
    NameFilter="*",
    GroupByLayer=False,
    GroupByType=False,
    IncludeHidden=True,
    IncludeLocked=True,
    enableFullPath=True,
    listenToAttributes=True)
brep = Brep(dpipeline)
ptuo = GHPythonToUserObject(Toggle=Toggle(False), LocalFolder="/Users/karimdaw/Projects/FacadeManager/FM-Python", Category="FM-Python")  # -> TLOC; inputs Toggle: Boolean
# ---------- ptuo: Python ----------
"""
Iterates the GHPython components in the document and makes user objects of them
if the their Category property matches the input Category parameter. Also grabs
all the code and writes this to .py files.

    Input:
        Toggle: Activate the component using a boolean toggle {item,bool}
        Folder: The folder/directory to save the user objects and source code to {item,str}
        Category: The name of the category for which to make user objects {item,str}
    Output:
        TLOC: Lines of code in user object {item,int}
    Remarks:
        Author: Anders Holden Deleuran
        Contributor: Karim Daw
        License: Apache License 2.0
        Version: 250621
"""
ghenv.Component.Name = "GHPythonToUserObject"
ghenv.Component.NickName = "PTUO"
ghenv.Component.Category = "FM-Python"
ghenv.Component.SubCategory = "0-Dev"

import os
import Grasshopper as gh
import getpass

def ghPythonToUserObject(ghPyComp,writeFolder):
    
    """ 
    Automates the creation of a GHPython user object. Based on this thread:
    http://www.grasshopper3d.com/forum/topics/change-the-default-values-for-userobject-popup-menu
    """
    
    # Make a user object
    uo = gh.Kernel.GH_UserObject()
    
    # Set its properties based on the GHPython component properties
    uo.Icon = ghPyComp.Icon_24x24    
    uo.BaseGuid = ghPyComp.ComponentGuid
    uo.Exposure = ghenv.Component.Exposure.primary
    uo.Description.Name = ghPyComp.Name
    uo.Description.Description = ghPyComp.Description
    uo.Description.Category = ghPyComp.Category
    uo.Description.SubCategory = ghPyComp.SubCategory
    
    # Set the user object data and save to file
    uo.SetDataFromObject(ghPyComp)
    uo.Path = os.path.join(writeFolder,ghPyComp.Name+".ghuser")
    uo.SaveToFile()
    
    # Update the grasshopper ribbon UI (doesn't seem to work)
    #gh.Kernel.GH_ComponentServer.UpdateRibbonUI()

def exportGHPythonSource(ghPyComp,writeFolder):
    
    """ Export the source code of a GHPython component """
    
    # Get code and lines of code
    code = ghPyComp.Code
    code = code.replace("\r","")
    lines = code.splitlines()
    loc = len(lines)
    
    # Check/make source file folder
    srcFolder = os.path.join(writeFolder,"src")
    if not os.path.isdir(srcFolder):
        os.makedirs(srcFolder)
        
    # Write code to .py file
    srcFile = os.path.join(srcFolder,ghPyComp.Name + ".py")
    f = open(srcFile,"w")
    f.write(code)
    f.close()
    
    return loc

if Toggle and LocalFolder and Category:
    
    # Make GH component warning handler
    wh = gh.Kernel.GH_RuntimeMessageLevel.Warning
    
    # Get user name
    username=getpass.getuser()

    # get local GH componenet folder
    localGhFolder = "/Users/karimdaw/Library/Application Support/McNeel/Rhinoceros/7.0/Plug-ins/Grasshopper (b45a29b1-4343-4035-989e-044e8580d9cf)/UserObjects"
 
    Folders = [LocalFolder,localGhFolder]
    
    # Iterate the canvas and get to the GHPython components
    TLOC = 0
    for obj in ghenv.Component.OnPingDocument().Objects:
        if type(obj) is type(ghenv.Component):
            
            # Check that category matches and export to files
            if obj.Category == Category:
                
                #loop through folders you want to save to
                for f in Folders:
                    ghPythonToUserObject(obj,f)
                    loc = exportGHPythonSource(obj,f)
                    TLOC += loc
                    obj.AddRuntimeMessage(wh,"I was just saved as a user object, hooray!")
# ---------- end ptuo ----------
ub = UncapBreps(CappedBreps=brep, OffsetDistance=Slider(1, range=0..10))  # -> VerticalSurfaces, TopSurface, BottomSurface; inputs CappedBreps: list
# ---------- ub: Python ----------
"""
Uncaps breps and return breps without top or bottom surfaces
-
    Args:
        CappedBreps: Breps to uncap {list,Breps}
        Tolerance: A number indicating the tolerance by which we cull the surfaces we dont want appearing {item,number}
    Returns:
        UnCappedBreps: List of uncapped Breps {list,Breps}
        TopSurface: Top surface as a Brep {item, Brep}
        BottomSurface: Bottom surface as a Brep {item, Brep}
    Remarks:
        Author: Karim Daw (BIG IDEAS)
        Project: EDUES
        License:
        Version: 250604001
"""

# Give your component a unique name and nickname (portrayed on the canvas).
ghenv.Component.Name = "UncapBreps"
ghenv.Component.NickName = "UB"

# Keep it in the "Performing" tab
ghenv.Component.Category = "FM-Python"

# Define the subcategory
ghenv.Component.SubCategory = "1-Utilities"

import time
import math
import Rhino
import Grasshopper as gh


# If you want to give the component a version number etc.
ghenv.Component.Message = time.strftime("%d/%m/%Y") + "\n" + time.strftime("%H:%M:%S")

def unCapBrep(brep, offsetDis, tol):
    
    verticalSurfaces = []
    bottomSurface = Rhino.Geometry.Brep()
    topSurface = Rhino.Geometry.Brep()
    
    # Get faces from breps
    for i, face in enumerate(brep.Faces):
        
        # Evaluate Surface
        vec = face.NormalAt(0.5,0.5)
        
        # Check if normal is pointing up or down within tolerance
        if vec.Z <= 0 + tol and vec.Z >= 0 - tol:
            
            b = Rhino.Geometry.BrepFace.DuplicateFace(face,False)
            
            # Append to vertical
            verticalSurfaces.append(b)
        
        elif vec.Z <= 0:
            
            # Append top master list of top brep
            bottomSurface = face
  
        elif vec.Z >= 0:

            # Append top master list of top brep
            topSurface = face
    
    # Join vertical surface
    band = Rhino.Geometry.Brep.JoinBreps(verticalSurfaces,0.01)
    
    
    if offsetDis != 0.0:
        
        # Unpack band
        band = band[0]
        
        # offsetBand gives back 3 things, i just want the first one
        offsetBand = Rhino.Geometry.Brep.CreateOffsetBrep(band,offsetDis,False,False,False,0.01)
        offsetBand = offsetBand[0]
    
    else:
        offsetBand = band


    return offsetBand, bottomSurface, topSurface


# Run
# Default inputs


if not Tolerance:
    Tolerance = 0.01
if not OffsetDistance:
    OffsetDistance = 0.5

if CappedBreps:
    
    VerticalSurfaces = []
    TopSurface = []
    BottomSurface = []

    for b in CappedBreps:
        
        vS, tS, bS = unCapBrep(b,-1*OffsetDistance,0.01)
        
        # save surfaces
        VerticalSurfaces.append(*vS)
        TopSurface.append(tS)
        BottomSurface.append(bS)
# ---------- end ub ----------
brep_2 = Brep(ub.VerticalSurfaces)
