# Grasshopper definition Facade_Manager_GH_v0.1.gh (Grasshopper 1.0.7)
# plug-ins: Pufferfish, MeshEdit Components, Human, Weaverbird

# ----
# Step 1: Input Mass
# Mass
# Layer
# Facade Thickness
# Step 2 : Set Grid
number_slider = Slider(0.3, range=0..2)
# Parameters Facade
pipeline = GeometryPipeline(
    GroupByLayer=False,
    GroupByType=False,
    IncludeHidden=True,
    IncludeLocked=True,
    LayerFilter="Simple_Volume::mass",
    NameFilter="*",
    SublayerFiltering=True,
    TypeFilter=1073741848)

# ----
# Step 4: Preview Model
list = ValueList({"Mesh Type": 0, "Mesh Heights": 1, "Mesh Accuracy": 2, "Hide Mesh": 3}, selected="Mesh Type")
gate = StreamGate(Stream=list, Gate=list)  # -> Target0, Target1, Target2, Target3
replace = ReplaceItems(List=gate.Target0, Item=True, Indices=0, Wrap=False)  # -> flatten(List)
replace_2 = ReplaceItems(List=gate.Target1, Item=True, Indices=0, Wrap=False)  # -> flatten(List)
replace_3 = ReplaceItems(List=gate.Target2, Item=True, Indices=0, Wrap=False)  # -> flatten(List)

# ----
# Family
# North
# East
# South
# West
list_2 = ValueList({"A", "B", "C", "D", "E", "F", "G", "H", "Z"}, selected="C")
list_3 = ValueList({"A", "B", "C", "D", "E", "F", "G", "H", "Z"}, selected="D")
list_4 = ValueList({"A", "B", "C", "D", "E", "F", "G", "H", "Z"}, selected="A")
list_5 = ValueList({"A", "B", "C", "D", "E", "F", "G", "H", "Z"}, selected="B")

# ----
# Corner Blocks
toggle = BooleanToggle(False)

# ----
# Configuration Type
list_6 = ValueList({"Simple": 0, "Ends": 1, "Checker Board": 2, "Alternate Horizontal": 3, "Alternate Vertical": 4, "Attractor": 5, "Random": 6, "Orientation": 7}, selected="Simple")

# ----
# Scale Blocks
# X Direction
# Y Direction
toggle_2 = BooleanToggle(True)

# ----
# Grid Type
list_7 = ValueList({"Normal Grid": 0, "Shifted Grid": 1, "Existing Grid": 2}, selected="Normal Grid")

# ----
# Grid Size
# Step 3: Set Configuration
list_8 = ValueList({"1/3", "1/2": 0.5, "1", "2", "3", "4", "5", "6"}, selected="1")
multiplication = Multiplication(A=Slider(4.2, range=0..10), B=list_8)
panel_target_width = Panel(multiplication)

# ----
# Existing Grid
pipeline_2 = GeometryPipeline(
    GroupByLayer=False,
    GroupByType=False,
    IncludeHidden=True,
    IncludeLocked=True,
    LayerFilter="Grid",
    NameFilter="*",
    SublayerFiltering=True,
    TypeFilter=4)
data = Data(pipeline_2)

# ----
# Step 5: Bake and check Blocks
# Bake Facade
button = Button()

# ----
# Attractor Setting
# Direction Attractor
# Get Attractor
# Attractor Power
pipeline_3 = GeometryPipeline(
    GroupByLayer=False,
    GroupByType=False,
    IncludeHidden=True,
    IncludeLocked=True,
    LayerFilter="02_Facade::Facade_Blocks::crv",
    NameFilter="*",
    SublayerFiltering=True,
    TypeFilter=1073741852)
list_9 = ValueList({"Dir1": 0, "Dir2": 1}, selected="Dir1")

# ----
# Facade Thicknes Preperation
data_2 = Data(pipeline)
sort_surfaces = SortSurfaces(B=data_2, custom_order=0)  # -> lowest_2, highest_2, custom_2, remove_cap_2
evalsrf = EvaluateSurface(Surface=reparameterize(sort_surfaces.highest_2), Point="{0.5,0.5,0}")  # -> Point, Normal, UDirection, VDirection, Frame
evalsrf_2 = EvaluateSurface(Surface=reparameterize(sort_surfaces.lowest_2), Point="{0.5,0.5,0}")  # -> Point, Normal, UDirection, VDirection, Frame
debrep = DeconstructBrep(Brep=sort_surfaces.highest_2)  # -> Faces, Edges, Vertices
join = JoinCurves(Curves=debrep.Edges, Preserve=False)  # -> simplify(Curves)
offcrv = OffsetCurve(Curve=simplify(join), Distance=number_slider, Plane=PlaneXY(0, 0, 0), BothSides=True, Kinks=0, CapType=1)
lng = ListLength(List=data_2)
tstat = TreeStatistics(Tree=offcrv)  # -> Paths, Length, Count
pshift = ShiftPaths(Data=offcrv, Offset=-1)
dist = Distance(PointA=evalsrf.Point, PointB=evalsrf_2.Point)
larger = LargerThan(FirstNumber=tstat.Count, SecondNumber=lng)  # -> LargerThan, OrEqualTo
filter = StreamFilter(Gate=larger.LargerThan, Stream0=offcrv, Stream1=pshift)
Z = UnitZ(Factor=dist)
division = Division(A=dist, B=Slider(2, range=0..10))
curvepoint = PointOnCurve(filter, parameter=0.5)
Z_2 = UnitZ(Factor=division)
neg = Negative(Value=Z_2)
move = Move(Geometry=curvepoint, Motion=neg)  # -> Geometry, Transform
data_3 = Data(simplify(move.Geometry))
match = MatchTree(Tree=data_3, Guide=filter)  # -> simplify(Tree)
brepinc = PointInBrep(Brep=graft(data_2), Point=match, Strict=False)  # -> simplify(Inside)
cull = CullPattern(List=filter, CullPattern=brepinc)
data_4 = Data(cull)
neg_2 = Negative(Value=Z)  # -> simplify(Result)
boundary = BoundarySurfaces(Edges=data_4)
extr = Extrude(Base=boundary, Direction=neg_2)
data_5 = Data(extr)

lng_2 = ListLength(List=data_2)
equals = Equality(FirstNumber=lng_2, SecondNumber=Slider(1, range=0..1))  # -> Equality, Inequality
number_slider_2 = Slider(100, range=0..100)

# ---- group: Masses Offset
cap = CapHoles(Brep=data_5)  # -> flatten(Brep)

# ----
number_slider_3 = Slider(2, range=0..10)
filter_2 = StreamFilter(Gate=equals.Equality, Stream0=Slider(-1, range=-1..0), Stream1=Slider(0, range=0..1))

# ----
# Existing Grid
number_slider_4 = Slider(500, range=0..1000)
data_6 = Data(data)
Z_3 = UnitZ(Factor=number_slider_4)
extr_2 = Extrude(Base=data_6, Direction=Z_3)
lng_3 = ListLength(List=data_2)
python = GhPythonScript(x=lng_3)  # -> a
# ---------- python: Python ----------
__author__ = "MTS"
__version__ = "2021.03.23"

import rhinoscriptsyntax as rs
if (x==1):
    a=0
else:
    a=1
# ---------- end python ----------

# ----
# Shifted Grid
number_slider_5 = Slider(2, range=0..10)
pl = ConstructPlane(Origin=Point(0, 0, 0), XAxis=Vector(1, 0, 0), YAxis=Vector(0, 1, 0))
lng_4 = ListLength(List=data_2)
larger_2 = LargerThan(FirstNumber=lng_4, SecondNumber=Slider(1, range=0..1))  # -> LargerThan, OrEqualTo

# ----
# Create Mesh with Corners
number_slider_6 = Slider(-1, range=-1..0)
merge = Merge(Data1=Slider(0, range=0..100), Data2=Slider(-1, range=-1..0))
number_slider_7 = Slider(100, range=0..100)
number_slider_8 = Slider(1, range=0..1)
number_slider_9 = Slider(1, range=0..1)
merge_2 = Merge(Data1=Slider(0, range=0..100), Data2=Slider(1, range=0..1))
merge_3 = Merge(Data1=Slider(0, range=0..100), Data2=Slider(1, range=0..1))

# ----
# Normal Grid
number_slider_10 = Slider(0.1, range=0..0.1)
tstat_2 = TreeStatistics(Tree=data_2)  # -> Paths, Length, Count
larger_3 = LargerThan(FirstNumber=tstat_2.Length, SecondNumber=Slider(1, range=0..1))  # -> LargerThan, OrEqualTo

# ----
# Panalizer
# Preperation to group Buildings
brep = Brep(simplify(cap))

# ---- group: Creat Grid / Use Existing Grid
gate_2 = StreamGate(Stream=brep, Gate=0)  # -> Target0, Target1

# ----
data_7 = Data(gate_2.Target0)
volume = Volume(Geometry=data_7)  # -> Volume, Centroid
project = Project(Geometry=volume.Centroid, Plane=PlaneXY(0, 0, 0))  # -> Geometry, Transform
pgroups = PointGroups(Points=project.Geometry, Distance=Slider(0.1, range=0..0.1))  # -> Groups, Indices
item = ListItem(List=data_7, Index=pgroups.Indices, Wrap=True)  # -> simplify(Item)

area = Area(Geometry=item)  # -> Area, Centroid

pdecon = Deconstruct(Point=area.Centroid)  # -> XComponent, YComponent, ZComponent
sort = SortList(Keys=pdecon.ZComponent, ValuesA=item)  # -> Keys, ValuesA
brep_2 = Brep(simplify(sort.ValuesA))
box_properties = BoxProperties(B=brep_2)  # -> out, xDim, yDim, zDim, bBasePt, bTopPoint, bCentre, bPts; inputs B: Box
# ---------- box_properties: Python ----------
"""
 A small utility to get some basic box properties
"""
import Rhino

"""
inputs:
    B= a or lisst of boxes (item access)

Outputs:
    xDim=   width of the box
    yDim= length of the box
    zDim= Height of the box
    
    bBasePointt= lowest point of the box (min x,y,z values)
    bTopPoint= highest point of the box (max x,y,z values)
    bCentre= centre point of the box
"""

ghenv.Component.Name = "Box Properties"
ghenv.Component.NickName = "Box Properties"

# Keep it in the "Performing" tab
ghenv.Component.Category = "Performing"

# Define the subcategory

#ghenv.Component.SubCategory = "1 Automation"
ghenv.Component.SubCategory = "2 Geometry"
#ghenv.Component.SubCategory = "3 Environmental"

try:
    
    xDim=B.X[1]-B.X[0]
    yDim=B.Y[1]-B.Y[0]
    zDim=B.Z[1]-B.Z[0]
    
    bBasePt=Rhino.Geometry.Point3d(B.X[0],B.Y[0],B.Z[0])
    bTopPoint=Rhino.Geometry.Point3d(B.X[1],B.Y[1],B.Z[1])
    
    bCentre=B.Center

except:
    print "please insert one or more valid bounding boxes as input"
# ---------- end box_properties ----------
xy = XYPlane(Origin=box_properties.bCentre)
sec = BrepPlane(Brep=brep_2, Plane=xy)  # -> Curves, Points
division_2 = Division(A=box_properties.zDim, B=2)
pshift_2 = ShiftPaths(Data=sec.Curves, Offset=-1)  # -> simplify(Data)
Z_4 = UnitZ(Factor=division_2)
neg_3 = Negative(Value=Z_4)
move_2 = Move(Geometry=pshift_2, Motion=neg_3)  # -> Geometry, Transform

# ---- group: Normal Grid / Shifted Grid / Existing Grid
gate_3 = StreamGate(Stream=move_2.Geometry, Gate=list_7)  # -> simplify(Target0), simplify(Target1), simplify(Target2)

# ----
explode = Explode(Curve=gate_3.Target0, Recursive=True)  # -> Segments, Vertices
move_3 = Move(Geometry=pshift_2, Motion=Z_4)  # -> Geometry, Transform
explode_2 = Explode(Curve=move_3.Geometry, Recursive=True)  # -> simplify(Segments), Vertices
len = Length(Curve=explode.Segments)
curvepoint_2 = PointOnCurve(explode.Segments, parameter=0.5)
curvepoint_3 = PointOnCurve(explode_2.Segments, parameter=0.507)
division_3 = Division(A=len, B=panel_target_width)
dist_2 = Distance(PointA=curvepoint_2, PointB=curvepoint_3)
int = Integer(division_3)
item_2 = ListItem(List=dist_2, Index=0, Wrap=True)
divide = DivideCurve(Curve=explode.Segments, Count=int, Kinks=False)  # -> Points, Tangents, Parameters
pshift_3 = ShiftPaths(Data=divide.Points, Offset=-1)
pt = Point(pshift_3)
shift = ShiftList(List=pt, Shift=1, Wrap=False)
shift_2 = ShiftList(List=pt, Shift=-1, Wrap=False)
dist_3 = Distance(PointA=shift, PointB=shift_2)
larger_4 = LargerThan(FirstNumber=dist_3, SecondNumber=number_slider_10)  # -> LargerThan, OrEqualTo
cull_2 = CullPattern(List=pt, CullPattern=larger_4.OrEqualTo)
gate_4 = StreamGate(Stream=cull_2, Gate=larger_3.LargerThan)  # -> Target0, Target1
merge_4 = Merge(Data1=gate_4.Target0, Data2=gate_4.Target1)
Z_5 = UnitZ(Factor=item_2)
move_4 = Move(Geometry=merge_4, Motion=Z_5)  # -> Geometry, Transform
unflatten = UnflattenTree(Tree=move_4.Geometry, Guide=cull_2)
lng_5 = ListLength(List=unflatten)
merge_5 = Merge(Data1=cull_2, Data2=unflatten)
frompoints = MeshFromPoints(Points=merge_5, UDirection=2, VDirection=lng_5)

sort_surfaces_2 = SortSurfaces(B=brep_2, custom_order=0)  # -> lowest_2, highest_2, custom_2, remove_cap_2
data_8 = Data(gate_3.Target1)
debrep_2 = DeconstructBrep(Brep=simplify(sort_surfaces_2.highest_2))  # -> Faces, Edges, Vertices
join_2 = JoinCurves(Curves=debrep_2.Edges, Preserve=False)  # -> simplify(Curves)
lng_6 = ListLength(List=join_2)
larger_5 = LargerThan(FirstNumber=lng_6, SecondNumber=number_slider_5)  # -> LargerThan, flatten(OrEqualTo)
data_9 = Data(box_properties.zDim)
cull_3 = CullPattern(List=flatten(lng_6), CullPattern=larger_5.OrEqualTo)
mindex = MemberIndex(Set=larger_5.OrEqualTo, Member=Toggle(True))  # -> Index, Count
unflatten_2 = UnflattenTree(Tree=larger_5.OrEqualTo, Guide=data_9)  # -> flatten(Tree)
flatten = FlattenTree(Tree=data_9, Path="{0}")
flatten_2 = FlattenTree(Tree=cull_3, Path="{0}")
sift = SiftPattern(List=flatten, SiftPattern=unflatten_2)  # -> Output0, Output1
clean = CleanTree(RemoveNulls=True, RemoveInvalid=True, RemoveEmpty=True, Tree=sift.Output1)
subtraction = Subtraction(A=flatten_2, B=Slider(1, range=0..1))
dup = DuplicateData(Data=graft(clean), Number=graft(subtraction), Order=True)  # -> flatten(Data)
series = Series(Start=mindex.Index, Step=Slider(1, range=0..1), Count=subtraction)  # -> flatten(Series)
curvepoint_4 = PointOnCurve(data_8, parameter=0.5)
ins = InsertItems(List=flatten, Item=dup, Indices=series, Wrap=True)
pull = PullPoint(Point=curvepoint_4, Geometry=pl, ClosestOnly=True)  # -> ClosestPoint, Distance
unflatten_3 = UnflattenTree(Tree=ins, Guide=data_8)
sort_2 = SortList(Keys=pull.Distance, ValuesA=data_8, ValuesB=unflatten_3)  # -> Keys, ValuesA, ValuesB
curvepoint_5 = PointOnCurve(sort_2.ValuesA, parameter=0.5)
data_10 = Data(simplify(pgroups.Groups))
project_2 = Project(Geometry=curvepoint_5, Plane=PlaneXY(0, 0, 0))  # -> Geometry, Transform
item_3 = ListItem(List=data_10, Index=0, Wrap=True)
pgroups_2 = PointGroups(Points=project_2.Geometry, Distance=Slider(0.1, range=0..0.1))  # -> Groups, Indices
pshift_4 = ShiftPaths(Data=pgroups_2.Groups, Offset=-1)
pull_2 = PullPoint(Point=pshift_4, Geometry=item_3, ClosestOnly=True)  # -> ClosestPoint, Distance
sort_3 = SortList(Keys=pull_2.Distance, ValuesA=sort_2.ValuesA, ValuesB=sort_2.ValuesB)  # -> Keys, ValuesA, ValuesB
filter_3 = StreamFilter(Gate=0, Stream0=sort_2.ValuesA, Stream1=sort_3.ValuesA)
split = SplitTree(Data=filter_3, Masks=flatten("{*}[1,3,...]"))  # -> Positive, Negative
data_11 = Data(split.Negative)
data_12 = Data(split.Positive)
explode_3 = Explode(Curve=data_11, Recursive=True)  # -> Segments, Vertices
explode_4 = Explode(Curve=data_12, Recursive=True)  # -> Segments, Vertices
crv = Curve(explode_4.Segments)
crv_2 = Curve(explode_3.Segments)
len_2 = Length(Curve=crv_2)
len_3 = Length(Curve=crv)
division_4 = Division(A=len_2, B=panel_target_width)
division_5 = Division(A=len_3, B=panel_target_width)
int_2 = Integer(division_4)
int_3 = Integer(division_5)
range = Range(Domain=Domain(0, 1), Steps=int_2)
range_2 = Range(Domain=Domain(0, 1), Steps=int_3)
item_4 = ListItem(List=range, Index=0, Wrap=True)
item_5 = ListItem(List=range, Index=Slider(1, range=0..1), Wrap=True)
subtraction_2 = Subtraction(A=item_5, B=item_4)
division_6 = Division(A=subtraction_2, B=Slider(2, range=0..10))
addition = Addition(A=range, B=division_6)
lng_7 = ListLength(List=range)
cull_i = CullIndex(List=addition, Indices=expr("x-1", lng_7), Wrap=True)  # -> simplify(List)
tstat_3 = TreeStatistics(Tree=cull_i)  # -> Paths, Length, Count
repeat = RepeatData(Data=Slider(1, range=0..1), Length=tstat_3.Count)  # -> graft(Data)
repeat_2 = RepeatData(Data=Slider(0, range=0..100), Length=tstat_3.Count)  # -> graft(Data)
match_2 = MatchTree(Tree=repeat, Guide=cull_i)
match_3 = MatchTree(Tree=repeat_2, Guide=cull_i)
eval = EvaluateCurve(Curve=reparameterize(graft(crv)), Parameter=range_2)  # -> Point, Tangent, Angle
merge_6 = Merge(Data1=match_3, Data2=cull_i, Data3=match_2)
eval_2 = EvaluateCurve(Curve=reparameterize(graft(crv_2)), Parameter=merge_6)  # -> Point, Tangent, Angle
gate_5 = StreamGate(Stream=eval.Point, Gate=larger_2.LargerThan)  # -> Target0, Target1
gate_6 = StreamGate(Stream=eval_2.Point, Gate=larger_2.LargerThan)  # -> Target0, Target1
pshift_5 = ShiftPaths(Data=gate_5.Target1, Offset=-1)
pshift_6 = ShiftPaths(Data=gate_6.Target1, Offset=-1)
merge_7 = Merge(Data1=pshift_5, Data2=gate_5.Target0)
merge_8 = Merge(Data1=pshift_6, Data2=gate_6.Target0)
merge_9 = Merge(Data1=merge_7, Data2=merge_8)
data_13 = Data(merge_9)
shift_3 = ShiftList(List=data_13, Shift=1, Wrap=False)
shift_4 = ShiftList(List=data_13, Shift=-1, Wrap=False)
dist_4 = Distance(PointA=shift_3, PointB=shift_4)
larger_6 = LargerThan(FirstNumber=dist_4, SecondNumber=0.1)  # -> LargerThan, OrEqualTo
filter_4 = StreamFilter(Gate=0, Stream0=sort_2.ValuesB, Stream1=sort_3.ValuesB)
cull_4 = CullPattern(List=data_13, CullPattern=larger_6.OrEqualTo)
Z_6 = UnitZ(Factor=graft(filter_4))
move_5 = Move(Geometry=cull_4, Motion=Z_6)  # -> Geometry, Transform
flatten_3 = FlattenTree(Tree=move_5.Geometry, Path="{0}")
unflatten_4 = UnflattenTree(Tree=flatten_3, Guide=cull_4)
merge_10 = Merge(Data1=cull_4, Data2=unflatten_4)
lng_8 = ListLength(List=unflatten_4)  # -> simplify(Length)
frompoints_2 = MeshFromPoints(Points=merge_10, UDirection=2, VDirection=lng_8)

data_14 = Data(gate_3.Target2)
explode_5 = Explode(Curve=data_14, Recursive=True)  # -> Segments, Vertices
end = EndPoints(Curve=explode_5.Segments)  # -> Start, End
move_6 = Move(Geometry=pshift_2, Motion=Z_4)  # -> Geometry, Transform
explode_6 = Explode(Curve=move_6.Geometry, Recursive=True)  # -> simplify(Segments), Vertices
curvepoint_6 = PointOnCurve(explode_5.Segments, parameter=0.5)
curvepoint_7 = PointOnCurve(explode_6.Segments, parameter=0.507)
dist_5 = Distance(PointA=curvepoint_6, PointB=curvepoint_7)
item_6 = ListItem(List=dist_5, Index=0, Wrap=True)
Z_7 = UnitZ(Factor=item_6)

graft = GraftTree(Tree=data_14, IncludeEmptyLists=True, IncludeNullItems=True)

scx = SurfaceCurve(Surface=extr_2, Curve=graft)  # -> Curves, Points, UVPoints, Normals, Parameters, Tangents

pshift_7 = ShiftPaths(Data=scx.Points, Offset=-1)

gate_7 = StreamGate(Stream=pshift_7, Gate=python)  # -> Target0, Target1
flatten_4 = FlattenTree(Tree=gate_7.Target0, Path="{0}")
merge_11 = Merge(Data1=flatten_4, Data2=gate_7.Target1)
crv_cp = CurveClosestPoint(Point=merge_11, Curve=graft)  # -> Point, Parameter, Distance
merge_12 = Merge(Data1=crv_cp.Point, Data2=end.Start)
alongcrv = SortAlongCurve(Points=merge_12, Curve=graft)  # -> simplify(Points), Indices
crv_cp_2 = CurveClosestPoint(Point=alongcrv.Points, Curve=graft)  # -> Point, simplify(Parameter), Distance
shatter = Shatter(Curve=graft, Parameters=crv_cp_2.Parameter)
end_2 = EndPoints(Curve=shatter)  # -> Start, End
pshift_8 = ShiftPaths(Data=end_2.Start, Offset=-1)
item_7 = ListItem(List=pshift_8, Index=0, Wrap=True)
lng_9 = ListLength(List=pshift_8)
ins_2 = InsertItems(List=pshift_8, Item=item_7, Indices=lng_9, Wrap=True)
move_7 = Move(Geometry=ins_2, Motion=Z_7)  # -> Geometry, Transform
merge_13 = Merge(Data1=ins_2, Data2=move_7.Geometry)
lng_10 = ListLength(List=simplify(move_7.Geometry))
frompoints_3 = MeshFromPoints(Points=merge_13, UDirection=2, VDirection=lng_10)

# ----
# Remap Paths Properly
merge_14 = Merge(Data1=frompoints, Data2=frompoints_2, Data3=frompoints_3)
data_15 = Data(merge_14)
tstat_4 = TreeStatistics(Tree=data_15)  # -> Paths, Length, Count
item_8 = ListItem(List=tstat_4.Paths, Index=0, Wrap=True)
chars = Characters(Text=item_8)  # -> Result, Unicode
cset = CreateSet(List=chars.Result)  # -> Set, Map
item_9 = ListItem(List=cset.Set, Index=Slider(1, range=0..1), Wrap=True)
mindex_2 = MemberIndex(Set=chars.Result, Member=item_9)  # -> Index, Count
python_2 = GhPythonScript(x=mindex_2.Count)  # -> a
# ---------- python_2: Python ----------
__author__ = "MTS"
__version__ = "2021.03.23"

import rhinoscriptsyntax as rs
if (x==6):
    a=0
if (x==5):
    a=1
if (x==4):
    a=2
if (x==3):
    a=3
if (x==2):
    a=4
# ---------- end python_2 ----------
gate_8 = StreamGate(Stream=data_15, Gate=python_2)  # -> Target0, Target1, Target2, Target3, Target4
path_mapper = PathMapper(gate_8.Target2, source="{A;B;C;D}", target="{B;C}")
path_mapper_2 = PathMapper(gate_8.Target4, source="{A;B}", target="{A;B}")
path_mapper_3 = PathMapper(gate_8.Target1, source="{A;B;C;D;E}", target="{A;C}")
path_mapper_4 = PathMapper(gate_8.Target0, source="{A;B;C;D;E;F}", target="{A;B}")
path_mapper_5 = PathMapper(gate_8.Target3, source="{A;B;C}", target="{A;B}")
merge_15 = Merge(Data1=path_mapper_4, Data2=path_mapper_3, Data3=path_mapper, Data4=path_mapper_5, Data5=path_mapper_2)
explode_7 = MeshExplode(Mesh=merge_15, Interpolate=False)

# ----
# Main Mesh
pshift_9 = ShiftPaths(Data=explode_7, Offset=-1)

# ----
# Checkerboard
gate_9 = StreamGate(Stream=simplify(pshift_9), Gate=list_6)  # -> Target0, Target1, Target2, Target3, Target4, Target5, Target6, Target7
lng_11 = ListLength(List=simplify(pshift_9))
split_2 = SplitTree(Data=gate_9.Target2, Masks=flatten("{*;0,2,....}"))  # -> Positive, Negative
repeat_3 = RepeatData(Data=Slider(0, range=0..100), Length=lng_11)  # -> simplify(Data)
viewer = ParamViewer(split_2.Negative)
viewer_2 = ParamViewer(split_2.Positive)
branch = TreeBranch(Tree=simplify(repeat_3), Path=viewer, MaintainPaths=True)
merge_16 = Merge(Data1=Toggle(False), Data2=Toggle(True))
branch_2 = TreeBranch(Tree=simplify(repeat_3), Path=viewer_2, MaintainPaths=True)
merge_17 = Merge(Data1=Toggle(True), Data2=Toggle(False))
sift_2 = SiftPattern(List=branch, SiftPattern=merge_16)  # -> Output0, Output1
sift_3 = SiftPattern(List=branch_2, SiftPattern=merge_17)  # -> Output0, Output1
data_16 = Data(flatten(sift_2.Output1))
data_17 = Data(flatten(sift_3.Output1))
cset_2 = CreateSet(List=flatten(data_16))  # -> Set, Map
cset_3 = CreateSet(List=flatten(data_17))  # -> Set, Map
number_slider_11 = Slider(1, range=0..1)
mindex_3 = MemberIndex(Set=data_16, Member=cset_2.Set)  # -> Index, Count
mindex_4 = MemberIndex(Set=data_17, Member=cset_3.Set)  # -> Index, Count
replace_4 = ReplaceItems(List=data_16, Item=number_slider_11, Indices=mindex_3.Index, Wrap=False)
replace_5 = ReplaceItems(List=data_17, Item=number_slider_11, Indices=mindex_4.Index, Wrap=False)
unflatten_5 = UnflattenTree(Tree=replace_4, Guide=sift_2.Output1)
unflatten_6 = UnflattenTree(Tree=replace_5, Guide=sift_3.Output1)
combine = CombineData(Input0=sift_2.Output0, Input1=unflatten_5)  # -> Result, Index
combine_2 = CombineData(Input0=sift_3.Output0, Input1=unflatten_6)  # -> Result, Index
merge_18 = Merge(Data1=combine_2.Result, Data2=combine.Result)
clean_2 = CleanTree(RemoveNulls=True, RemoveInvalid=True, RemoveEmpty=False, Tree=merge_18)
merge_19 = Merge(Data1=list_4, Data2=list_2)
merge_20 = Merge(Data1=Slider(0, range=0..100), Data2=Slider(1, range=0..100))
replace_6 = ReplaceMembers(Set=clean_2, Find=merge_20, Replace=merge_19)

# ----
# Orient Planes
data_18 = Data(pshift_9)
demesh = DeconstructMesh(Mesh=data_18)  # -> Vertices, Faces, Colours, Normals
area_2 = Area(Geometry=data_18)  # -> Area, Centroid
item_10 = ListItem(List=demesh.Normals, Index=0, Wrap=True)
neg_4 = Negative(Value=item_10)
pshift_10 = ShiftPaths(Data=neg_4, Offset=-1)
line = LineSDL(Start=area_2.Centroid, Direction=pshift_10, Length=1)
frame = CurveFrame(Curve=reparameterize(line), Parameter=Slider(0, range=0..1))
deplane = DeconstructPlane(Plane=frame)  # -> Origin, XAxis, YAxis, ZAxis
pt_2 = ConstructPoint(XCoordinate=0, YCoordinate=0, ZCoordinate=0)
Z_8 = UnitZ(Factor=1)
rot3d = Rotate3D(Geometry=frame, Angle=1.570796327, Center=frame, Axis=deplane.YAxis)  # -> Geometry, Transform
line_2 = LineSDL(Start=pt_2, Direction=Vector(0, 0, 1), Length=Z_8)
deplane_2 = DeconstructPlane(Plane=rot3d.Geometry)  # -> Origin, XAxis, YAxis, ZAxis
angle = Angle(VectorA=line_2, VectorB=deplane_2.YAxis)  # -> Angle, Reflex
deg = Degrees(Radians=angle.Angle)
equals_2 = Equality(FirstNumber=deg, SecondNumber=Slider(0, range=0..100))  # -> Equality, Inequality
sift_4 = SiftPattern(List=deg, SiftPattern=equals_2.Equality)  # -> Output0, Output1
sift_5 = SiftPattern(List=rot3d.Geometry, SiftPattern=equals_2.Equality)  # -> Output0, Output1
neg_5 = Negative(Value=sift_4.Output0)
prot = RotatePlane(Plane=sift_5.Output0, Angle=degrees(neg_5))
data_19 = Data(sift_5.Output1)
combine_3 = CombineData(Input0=prot, Input1=data_19)  # -> Result, Index
vec = VectorXYZ(XComponent=0, YComponent=0, ZComponent=0)  # -> Vector, Length
line_3 = LineSDL(Start=vec.Vector, Direction=Vector(0, 0, 1), Length=1)
align = AlignPlane(Plane=combine_3.Result, Direction=line_3)  # -> Plane, Angle
neg_6 = Negative(Value=Slider(90, range=0..1000))
prot_2 = RotatePlane(Plane=align.Plane, Angle=degrees(neg_6))
deplane_3 = DeconstructPlane(Plane=prot_2)  # -> Origin, XAxis, YAxis, ZAxis
line_4 = LineSDL(Start=deplane_3.Origin, Direction=deplane_3.ZAxis, Length=Slider(2.15, range=0..100))

# ----
# Random
panel = Panel("Block")
gate_10 = StreamGate(Stream=simplify(prot_2), Gate=list_6)  # -> Target0, Target1, Target2, Target3, Target4, Target5, Target6, Target7
dpipeline = DynamicGeometryPipeline(
    LayerFilter="Facade_Blocks",
    TypeFilter=panel,
    NameFilter="*",
    GroupByLayer=False,
    GroupByType=False,
    IncludeHidden=True,
    IncludeLocked=True,
    enableFullPath=False,
    listenToAttributes=True)
tsort = SortText(Keys=dpipeline, Culture=127)  # -> Keys, Values
cset_4 = CreateSet(List=tsort.Keys)  # -> Set, Map
split_3 = TextSplit(Text=cset_4.Set, Separators=":")
item_11 = ListItem(List=split_3, Index=Slider(1, range=0..1), Wrap=True)
chars_2 = Characters(Text=item_11)  # -> Result, Unicode
item_12 = ListItem(List=chars_2.Result, Index=Slider(1, range=0..1), Wrap=True)  # -> flatten(Item)
tsort_2 = SortText(Keys=item_12, Culture=127)  # -> Keys, Values
pull_3 = PullPoint(Point=flatten(gate_10.Target6), Geometry=pipeline_3, ClosestOnly=True)  # -> ClosestPoint, Distance
bnd = Bounds(Numbers=pull_3.Distance)
data_20 = Data(tsort_2.Keys)
remap = RemapNumbers(Value=pull_3.Distance, Source=bnd, Target=Domain(0, 1))  # -> Mapped, Clipped
graph = GraphMapper(
    remap.Mapped,
    x0=0,
    x1=1,
    y0=0,
    y1=1,
    container_name="Bezier",
    cpx=[0, 0.5121212006, 0.3696969748, 1],
    cpy=[0, 0.2862903476, 0.8991935253, 1])
lng_12 = ListLength(List=graph)
bnd_2 = Bounds(Numbers=graph)
lng_13 = ListLength(List=data_20)
random = Random(Range=Domain(0, 1), Number=lng_12, Seed=2)
div = DivideDomain(Domain=bnd_2, Count=lng_13)
cset_5 = CreateSet(List=data_20)  # -> simplify(Set), Map
twn2nums = TweenTwoNumbers(NumberA=graft(graph), NumberB=graft(random), Factor=Slider(1, range=0..1))  # -> flatten(Tween)
fdom = FindDomain(Domains=div, Number=twn2nums, Strict=False)  # -> Index, Neighbour
cset_6 = CreateSet(List=fdom.Index)  # -> flatten(Set), Map
sort_4 = SortList(Keys=cset_6.Set)  # -> Keys, ValuesA
cset_7 = CreateSet(List=sort_4.Keys)  # -> simplify(flatten(Set)), Map
round = Round(Number=cset_7.Set)  # -> Nearest, Floor, Ceiling
replace_7 = ReplaceMembers(Set=fdom.Index, Find=round.Nearest, Replace=cset_5.Set)
graft_2 = GraftTree(Tree=simplify(replace_7), IncludeEmptyLists=True, IncludeNullItems=True)  # -> simplify(Tree)
unflatten_7 = UnflattenTree(Tree=graft_2, Guide=pshift_9)

# ----
# Configurations
gate_11 = StreamGate(Stream=simplify(prot_2), Gate=list_6)  # -> Target0, Target1, Target2, Target3, Target4, Target5, Target6, Target7

# ----
# Attractor
panel_2 = Panel("Block")
gate_12 = StreamGate(Stream=panel_2, Gate=0)  # -> Target0, Target1
merge_21 = Merge(Data1=gate_12.Target0, Data2=gate_12.Target1)
dpipeline_2 = DynamicGeometryPipeline(
    LayerFilter="Facade_Blocks",
    TypeFilter=merge_21,
    NameFilter="*",
    GroupByLayer=False,
    GroupByType=False,
    IncludeHidden=True,
    IncludeLocked=True,
    enableFullPath=False,
    listenToAttributes=True)
tsort_3 = SortText(Keys=dpipeline_2, Culture=127)  # -> Keys, Values
cset_8 = CreateSet(List=tsort_3.Keys)  # -> Set, Map
split_4 = TextSplit(Text=cset_8.Set, Separators=":")
item_13 = ListItem(List=split_4, Index=Slider(1, range=0..1), Wrap=True)
chars_3 = Characters(Text=item_13)  # -> Result, Unicode
item_14 = ListItem(List=chars_3.Result, Index=Slider(1, range=0..1), Wrap=True)  # -> flatten(Item)
number_slider_12 = Slider(1, range=0..1)
number_slider_13 = Slider(0, range=0..100)
tsort_4 = SortText(Keys=item_14, Culture=127)  # -> Keys, Values
dom = ConstructDomain(DomainStart=number_slider_12, DomainEnd=number_slider_13)
pull_4 = PullPoint(Point=flatten(gate_11.Target5), Geometry=pipeline_3, ClosestOnly=True)  # -> ClosestPoint, Distance
dom_2 = ConstructDomain(DomainStart=number_slider_13, DomainEnd=number_slider_12)
bnd_3 = Bounds(Numbers=pull_4.Distance)
filter_5 = StreamFilter(Gate=list_9, Stream0=dom_2, Stream1=dom)
data_21 = Data(tsort_4.Keys)
remap_2 = RemapNumbers(Value=pull_4.Distance, Source=bnd_3, Target=filter_5)  # -> Mapped, Clipped
graph_2 = GraphMapper(
    remap_2.Mapped,
    x0=0,
    x1=1,
    y0=0,
    y1=1,
    container_name="Bezier",
    cpx=[0, 0.5121212006, 0.3696969748, 1],
    cpy=[0, 0.2862903476, 0.8991935253, 1])
lng_14 = ListLength(List=graph_2)
bnd_4 = Bounds(Numbers=graph_2)
lng_15 = ListLength(List=data_21)
random_2 = Random(Range=Domain(0, 1), Number=lng_14, Seed=2)
div_2 = DivideDomain(Domain=bnd_4, Count=lng_15)
cset_9 = CreateSet(List=data_21)  # -> simplify(Set), Map
twn2nums_2 = TweenTwoNumbers(NumberA=graft(graph_2), NumberB=graft(random_2), Factor=Slider(0.3, range=0..1))  # -> flatten(Tween)
fdom_2 = FindDomain(Domains=div_2, Number=twn2nums_2, Strict=False)  # -> Index, Neighbour
cset_10 = CreateSet(List=fdom_2.Index)  # -> flatten(Set), Map
sort_5 = SortList(Keys=cset_10.Set)  # -> Keys, ValuesA
cset_11 = CreateSet(List=sort_5.Keys)  # -> simplify(flatten(Set)), Map
round_2 = Round(Number=cset_11.Set)  # -> Nearest, Floor, Ceiling
replace_8 = ReplaceMembers(Set=fdom_2.Index, Find=round_2.Nearest, Replace=cset_9.Set)
graft_3 = GraftTree(Tree=simplify(replace_8), IncludeEmptyLists=True, IncludeNullItems=True)  # -> simplify(Tree)
unflatten_8 = UnflattenTree(Tree=graft_3, Guide=pshift_9)

# ----
# Simple
gate_13 = StreamGate(Stream=pshift_9, Gate=list_6)  # -> Target0, Target1, Target2, Target3, Target4, Target5, Target6, Target7
lng_16 = ListLength(List=gate_13.Target0)
repeat_4 = RepeatData(Data=list_4, Length=lng_16)
data_22 = Data(repeat_4)

data_23 = Data(pshift_9)
facen = FaceNormals(Mesh=data_23)  # -> Centers, Normals
pshift_11 = ShiftPaths(Data=facen.Normals, Offset=-1)
amp = Amplitude(Vector=pshift_11, Amplitude=number_slider)
neg_7 = Negative(Value=amp)
move_8 = Move(Geometry=data_23, Motion=neg_7)  # -> Geometry, Transform
mjoin = MeshJoin(Meshes=move_8.Geometry)
disjoint = DisjointMesh(Mesh=mjoin)
explode_8 = MeshExplode(Mesh=disjoint, Interpolate=False)  # -> simplify(Faces)
data_24 = Data(explode_8)
item_15 = ListItem(List=data_24, Index=0, Wrap=True)
item_16 = ListItem(List=data_24, Index=number_slider_6, Wrap=True)
cull_i_2 = CullIndex(List=data_24, Indices=merge, Wrap=True)  # -> simplify(List)
medges = MeshEdges(Mesh=item_15)  # -> NakedEdges, InteriorEdges, NonManifoldEdges
medges_2 = MeshEdges(Mesh=item_16)  # -> NakedEdges, InteriorEdges, NonManifoldEdges
curvepoint_8 = PointOnCurve(medges_2.NakedEdges, parameter=0.5)
pdecon_2 = Deconstruct(Point=curvepoint_8)  # -> XComponent, YComponent, ZComponent
curvepoint_9 = PointOnCurve(medges.NakedEdges, parameter=0.5)
sort_6 = SortList(Keys=pdecon_2.ZComponent, ValuesA=medges_2.NakedEdges)  # -> Keys, ValuesA
pdecon_3 = Deconstruct(Point=curvepoint_9)  # -> XComponent, YComponent, ZComponent
sort_7 = SortList(Keys=pdecon_3.ZComponent, ValuesA=medges.NakedEdges)  # -> Keys, ValuesA
item_17 = ListItem(List=sort_6.ValuesA, Index=Slider(0, range=0..10), Wrap=True)  # -> simplify(Item)
item_18 = ListItem(List=sort_7.ValuesA, Index=Slider(3, range=0..10), Wrap=True)  # -> simplify(Item)
item_19 = ListItem(List=sort_7.ValuesA, Index=Slider(0, range=0..10), Wrap=True)  # -> simplify(Item)
item_20 = ListItem(List=sort_6.ValuesA, Index=Slider(3, range=0..10), Wrap=True)  # -> simplify(Item)

gate_14 = StreamGate(Stream=item_17, Gate=equals.Equality)  # -> Target0, Target1
gate_15 = StreamGate(Stream=item_18, Gate=equals.Equality)  # -> Target0, Target1
gate_16 = StreamGate(Stream=item_20, Gate=equals.Equality)  # -> Target0, Target1
gate_17 = StreamGate(Stream=item_19, Gate=equals.Equality)  # -> Target0, Target1
flatten_5 = FlattenTree(Tree=gate_14.Target1, Path="{0}")
flatten_6 = FlattenTree(Tree=gate_15.Target1, Path="{0}")
flatten_7 = FlattenTree(Tree=gate_16.Target1, Path="{0}")
pshift_12 = ShiftPaths(Data=gate_15.Target0, Offset=-1)
pshift_13 = ShiftPaths(Data=gate_16.Target0, Offset=-1)
flatten_8 = FlattenTree(Tree=gate_17.Target1, Path="{0}")
merge_22 = Merge(Data1=flatten_6, Data2=pshift_12)
merge_23 = Merge(Data1=flatten_7, Data2=pshift_13)

# ----
# Ends
gate_18 = StreamGate(Stream=pshift_9, Gate=list_6)  # -> Target0, Target1, Target2, Target3, Target4, Target5, Target6, Target7
data_25 = Data(gate_18.Target1)
unflatten_9 = UnflattenTree(Tree=data_25, Guide=explode_8)
split_5 = SplitTree(Data=unflatten_9, Masks=flatten("{*;*;0,2,...}"))  # -> Positive, Negative
data_26 = Data(split_5.Positive)
data_27 = Data(split_5.Negative)
lng_17 = ListLength(List=data_26)
lng_18 = ListLength(List=data_27)
subtraction_3 = Subtraction(A=lng_17, B=Slider(1, range=0..1))
subtraction_4 = Subtraction(A=lng_18, B=Slider(1, range=0..1))
range_3 = Range(Domain=subtraction_3, Steps=subtraction_3)
range_4 = Range(Domain=subtraction_4, Steps=subtraction_4)
replace_9 = ReplaceItems(List=data_27, Item=list_2, Indices=range_4, Wrap=False)
replace_10 = ReplaceItems(List=data_26, Item=list_4, Indices=range_3, Wrap=False)
merge_24 = Merge(Data1=replace_10, Data2=replace_9)
unflatten_10 = UnflattenTree(Tree=merge_24, Guide=data_25)

pshift_14 = ShiftPaths(Data=gate_14.Target0, Offset=-1)
pshift_15 = ShiftPaths(Data=gate_17.Target0, Offset=-1)
shift_5 = ShiftList(List=merge_23, Shift=Slider(-1, range=-1..0), Wrap=True)  # -> simplify(List)

merge_25 = Merge(Data1=flatten_5, Data2=pshift_14)
merge_26 = Merge(Data1=flatten_8, Data2=pshift_15)  # -> simplify(Result)
match_4 = MatchTree(Tree=shift_5, Guide=merge_22)

shift_6 = ShiftList(List=merge_25, Shift=Slider(-1, range=-1..0), Wrap=True)  # -> simplify(List)
merge_27 = Merge(Data1=graft(merge_22), Data2=graft(match_4))
ext = ExtendCurve(Curve=merge_27, Type=0, Start=number_slider_7, End=number_slider_7)
item_21 = ListItem(List=ext, Index=0, Wrap=True)  # -> Item, Item1
ccx = CurveCurve(CurveA=item_21.Item, CurveB=item_21.Item1)  # -> Points, ParamsA, ParamsB
shatter_2 = Shatter(Curve=item_21.Item, Parameters=ccx.ParamsA)
shatter_3 = Shatter(Curve=item_21.Item1, Parameters=ccx.ParamsB)
len_4 = Length(Curve=shatter_2)
len_5 = Length(Curve=shatter_3)
sort_8 = SortList(Keys=len_4, ValuesA=shatter_2)  # -> Keys, ValuesA
sort_9 = SortList(Keys=len_5, ValuesA=shatter_3)  # -> Keys, ValuesA
item_22 = ListItem(List=sort_9.ValuesA, Index=number_slider_9, Wrap=True)
item_23 = ListItem(List=sort_8.ValuesA, Index=number_slider_9, Wrap=True)
merge_28 = Merge(Data1=item_23, Data2=item_22)  # -> simplify(Result)
ccx_2 = CurveCurve(CurveA=graft(merge_28), CurveB=graft(merge_27))  # -> Points, simplify(ParamsA), ParamsB
shatter_4 = Shatter(Curve=graft(merge_28), Parameters=ccx_2.ParamsA)
len_6 = Length(Curve=shatter_4)
sort_10 = SortList(Keys=len_6, ValuesA=shatter_4)  # -> Keys, ValuesA
item_24 = ListItem(List=sort_10.ValuesA, Index=merge_3, Wrap=True)  # -> simplify(Item)
join_3 = JoinCurves(Curves=item_24, Preserve=False)  # -> simplify(Curves)
simplify = SimplifyCurve(Curve=join_3)  # -> simplify(Curve), Simplified
pshift_16 = ShiftPaths(Data=simplify.Curve, Offset=-1)
join_4 = JoinCurves(Curves=pshift_16, Preserve=False)
pshift_17 = ShiftPaths(Data=join_4, Offset=-1)  # -> simplify(Data)
simplify_2 = SimplifyCurve(Curve=pshift_17)  # -> Curve, Simplified
explode_9 = Explode(Curve=simplify_2.Curve, Recursive=True)  # -> simplify(Segments), Vertices
data_28 = Data(explode_9.Segments)
item_25 = ListItem(List=data_28, Index=0, Wrap=True)
item_26 = ListItem(List=data_28, Index=Slider(1, range=0..1), Wrap=True)

match_5 = MatchTree(Tree=shift_6, Guide=merge_26)

merge_29 = Merge(Data1=graft(merge_26), Data2=graft(match_5))
data_29 = Data(simplify(merge_29))
ext_2 = ExtendCurve(Curve=data_29, Type=0, Start=number_slider_2, End=number_slider_2)  # -> simplify(Curve)
item_27 = ListItem(List=ext_2, Index=0, Wrap=True)  # -> Item, Item1
ccx_3 = CurveCurve(CurveA=item_27.Item, CurveB=item_27.Item1)  # -> Points, ParamsA, ParamsB
shatter_5 = Shatter(Curve=item_27.Item, Parameters=ccx_3.ParamsA)
shatter_6 = Shatter(Curve=item_27.Item1, Parameters=ccx_3.ParamsB)
len_7 = Length(Curve=shatter_5)
len_8 = Length(Curve=shatter_6)
sort_11 = SortList(Keys=len_7, ValuesA=shatter_5)  # -> Keys, ValuesA
sort_12 = SortList(Keys=len_8, ValuesA=shatter_6)  # -> Keys, ValuesA
item_28 = ListItem(List=sort_12.ValuesA, Index=number_slider_8, Wrap=True)
item_29 = ListItem(List=sort_11.ValuesA, Index=number_slider_8, Wrap=True)
merge_30 = Merge(Data1=item_29, Data2=item_28)  # -> simplify(Result)
ccx_4 = CurveCurve(CurveA=merge_30, CurveB=data_29)  # -> Points, simplify(ParamsA), ParamsB
shatter_7 = Shatter(Curve=graft(merge_30), Parameters=ccx_4.ParamsA)  # -> simplify(Segments)
len_9 = Length(Curve=shatter_7)
sort_13 = SortList(Keys=len_9, ValuesA=shatter_7)  # -> Keys, ValuesA
item_30 = ListItem(List=sort_13.ValuesA, Index=merge_2, Wrap=True)  # -> simplify(Item)
join_5 = JoinCurves(Curves=item_30, Preserve=False)  # -> simplify(Curves)
simplify_3 = SimplifyCurve(Curve=join_5)  # -> simplify(Curve), Simplified
pshift_18 = ShiftPaths(Data=simplify_3.Curve, Offset=-1)
join_6 = JoinCurves(Curves=pshift_18, Preserve=False)
pshift_19 = ShiftPaths(Data=join_6, Offset=-1)  # -> simplify(Data)
explode_10 = Explode(Curve=pshift_19, Recursive=True)  # -> simplify(Segments), Vertices
data_30 = Data(explode_10.Segments)
item_31 = ListItem(List=data_30, Index=0, Wrap=True)
item_32 = ListItem(List=data_30, Index=Slider(1, range=0..1), Wrap=True)
merge_31 = Merge(Data1=item_31, Data2=item_25)  # -> simplify(Result)
merge_32 = Merge(Data1=item_32, Data2=item_26)  # -> simplify(Result)
loft = Loft(Curves=merge_31, Options={Adjust=False, Closed=False, LoftEnds=0, LoftSimp=0, LoftType=0, Rebuild=10, Refit=0.01})
loft_2 = Loft(Curves=merge_32, Options={Adjust=False, Closed=False, LoftEnds=0, LoftSimp=0, LoftType=0, Rebuild=10, Refit=0.01})
pshift_20 = ShiftPaths(Data=loft_2, Offset=filter_2)
shift_7 = ShiftList(List=pshift_20, Shift=Slider(1, range=0..1), Wrap=True)  # -> simplify(List)
smesh = SimpleMesh(Brep=loft)
unflatten_11 = UnflattenTree(Tree=shift_7, Guide=loft_2)
smesh_2 = SimpleMesh(Brep=unflatten_11)
flipm = FlipMesh(Mesh=smesh, VertexNormals=True, FaceNormals=True, FaceOrientation=False)
flipm_2 = FlipMesh(Mesh=smesh_2, VertexNormals=True, FaceNormals=True, FaceOrientation=False)

data_31 = Data(item_27.Item)
gate_19 = StreamGate(Stream=flipm_2, Gate=equals.Equality)  # -> Target0, Target1
gate_20 = StreamGate(Stream=flipm, Gate=equals.Equality)  # -> Target0, Target1
flatten_9 = FlattenTree(Tree=gate_20.Target1, Path="{0}")
pshift_21 = ShiftPaths(Data=gate_19.Target0, Offset=-1)
pshift_22 = ShiftPaths(Data=gate_20.Target0, Offset=-1)
shift_8 = ShiftList(List=pshift_21, Shift=Slider(-1, range=-1..0), Wrap=True)
shift_9 = ShiftList(List=pshift_22, Shift=Slider(1, range=0..1), Wrap=True)
shift_10 = ShiftList(List=flatten_9, Shift=1, Wrap=True)
unflatten_12 = UnflattenTree(Tree=shift_8, Guide=gate_19.Target0)
unflatten_13 = UnflattenTree(Tree=shift_9, Guide=gate_20.Target0)
unflatten_14 = UnflattenTree(Tree=shift_10, Guide=gate_20.Target1)
merge_33 = Merge(Data1=unflatten_13, Data2=unflatten_14)
filter_6 = StreamFilter(Gate=equals.Equality, Stream0=unflatten_12, Stream1=gate_19.Target1)

merge_34 = Merge(Data1=filter_6, Data2=cull_i_2, Data3=merge_33)  # -> simplify(Result)
pshift_23 = ShiftPaths(Data=merge_34, Offset=filter_2)

flatten_10 = FlattenTree(Tree=pshift_23, Path="{0}")
item_33 = ListItem(List=flatten(merge_34), Index=Slider(0, range=0..10), Wrap=True)
filter_7 = StreamFilter(Gate=equals.Equality, Stream0=pshift_23, Stream1=flatten_10)

data_32 = Data(filter_7)

# ----
# Oreientation
gate_21 = StreamGate(Stream=simplify(prot_2), Gate=list_6)  # -> Target0, Target1, Target2, Target3, Target4, Target5, Target6, Target7
data_33 = Data(line_4)
end_3 = EndPoints(Curve=data_33)  # -> Start, End
line_5 = Line(Line((84.7577947, 3.786713809, 0), (84.7577947, 33.36664756, 0)))
angle_2 = Angle(VectorA=data_33, VectorB=line_5, Plane=end_3.Start)  # -> Angle, Reflex
panel_3 = Panel("""0
90
270
180""")
deg_2 = Degrees(Radians=angle_2.Angle)  # -> flatten(Degrees)
num = Number(panel_3)
num_2 = Number(deg_2)
merge_35 = Merge(Data1=list_4, Data2=list_5, Data3=list_2, Data4=list_3)
panel_4 = Panel(merge_35)

# ---- group: Find nearest Value
python_3 = GhPythonScript(lst=num, y=num_2)  # -> flatten(out), a; inputs lst: list
# ---------- python_3: Python ----------
__author__ = "MTS"
__version__ = "2021.06.09"

import rhinoscriptsyntax as rs




def closest(lst, K):
      
    return lst[min(range(len(lst)), key = lambda i: abs(lst[i]-K))]
      
# Driver code
#lst = [3.64, 5.2, 9.42, 9.35, 8.5, 8]


K = y

print(closest(lst, K))
# ---------- end python_3 ----------

# ----
int_4 = Integer(python_3.out)
cset_12 = CreateSet(List=int_4)  # -> Set, Map
bnd_5 = Bounds(Numbers=cset_12.Set)
div_3 = DivideDomain(Domain=bnd_5, Count=Slider(4, range=0..10))
fdom_3 = FindDomain(Domains=div_3, Number=int_4, Strict=False)  # -> Index, Neighbour
cset_13 = CreateSet(List=fdom_3.Index)  # -> Set, Map
sort_14 = SortList(Keys=cset_13.Set)  # -> Keys, ValuesA
panel_5 = Panel(sort_14.Keys)
panel_6 = Panel(fdom_3.Index)
replace_11 = ReplaceMembers(Set=panel_6, Find=panel_5, Replace=panel_4)
unflatten_15 = UnflattenTree(Tree=replace_11, Guide=gate_21.Target7)

# ----
# Alternating Horizontal
gate_22 = StreamGate(Stream=simplify(pshift_9), Gate=list_6)  # -> Target0, Target1, Target2, Target3, Target4, Target5, Target6, Target7
split_6 = SplitTree(Data=gate_22.Target4, Masks=flatten("{*;0,2,...}"))  # -> Positive, Negative
data_34 = Data(split_6.Positive)
data_35 = Data(split_6.Negative)
lng_19 = ListLength(List=data_34)
lng_20 = ListLength(List=data_35)
repeat_5 = RepeatData(Data="0", Length=lng_19)  # -> simplify(Data)
repeat_6 = RepeatData(Data="1", Length=lng_20)  # -> simplify(Data)
match_6 = MatchTree(Tree=repeat_5, Guide=data_34)
match_7 = MatchTree(Tree=repeat_6, Guide=data_35)
merge_36 = Merge(Data1=match_6, Data2=match_7)
merge_37 = Merge(Data1=Slider(0, range=0..100), Data2=Slider(1, range=0..1))
clean_3 = CleanTree(RemoveNulls=True, RemoveInvalid=True, RemoveEmpty=False, Tree=merge_36)
panel_7 = Panel(merge_37)
merge_38 = Merge(Data1=list_4, Data2=list_2)

panel_8 = Panel(clean_3)

replace_12 = ReplaceMembers(Set=panel_8, Find=panel_7, Replace=merge_38)

# ----
# Alternating Vertical
gate_23 = StreamGate(Stream=simplify(pshift_9), Gate=list_6)  # -> Target0, Target1, Target2, Target3, Target4, Target5, Target6, Target7
data_36 = Data(gate_23.Target3)
panel_9 = Panel("""0
1""")
sift_6 = SiftPattern(List=data_36, SiftPattern=panel_9)  # -> Output0, Output1
nullrep = ReplaceNulls(Items=sift_6.Output0, Replacements=Slider(0, range=0..100))  # -> Items, Count
nullrep_2 = ReplaceNulls(Items=sift_6.Output1, Replacements=Slider(1, range=0..1))  # -> Items, Count
sift_7 = SiftPattern(List=nullrep.Items, SiftPattern=panel_9)  # -> Output0, Output1
sift_8 = SiftPattern(List=nullrep_2.Items, SiftPattern=panel_9)  # -> Output0, Output1
combine_4 = CombineData(Input0=sift_7.Output1, Input1=sift_8.Output0)  # -> Result, Index
merge_39 = Merge(Data1=Slider(0, range=0..100), Data2=Slider(1, range=0..1))
merge_40 = Merge(Data1=list_4, Data2=list_2)
clean_4 = CleanTree(RemoveNulls=True, RemoveInvalid=True, RemoveEmpty=False, Tree=combine_4.Result)
panel_10 = Panel(merge_39)

panel_11 = Panel(merge_40)
panel_12 = Panel(clean_4)

replace_13 = ReplaceMembers(Set=panel_12, Find=panel_10, Replace=panel_11)

filter_8 = StreamFilter(
    Gate=list_6,
    Stream0=data_22,
    Stream1=unflatten_10,
    Stream2=replace_6,
    Stream3=replace_13,
    Stream4=replace_12,
    Stream5=unflatten_8,
    Stream6=unflatten_7,
    Stream7=unflatten_15)
data_37 = Data(simplify(filter_8))

# ----
# Building
# Floor
# Face
# Panel
# Building
# Floor
# Panel
viewer_3 = ParamViewer(explode_8)
viewer_4 = ParamViewer(data_37)

# ----
# Assign_Blocks
panel_13 = Panel("Block")
dpipeline_3 = DynamicGeometryPipeline(
    LayerFilter="Facade_Blocks",
    TypeFilter=panel_13,
    NameFilter="*",
    GroupByLayer=False,
    GroupByType=False,
    IncludeHidden=True,
    IncludeLocked=True,
    enableFullPath=False,
    listenToAttributes=True)
blockexplode = ExplodeBlocks(BlockObjects=dpipeline_3, explodeGeom=True)  # -> Geometry, Attributes, flatten(BlockName), flatten(BoundingBox), BlockTransform, flatten(InsertionPlane), flatten(InstanceCount)
cset_14 = CreateSet(List=flatten(data_37))  # -> Set, Map
concat = Concatenate(FragmentA="*", FragmentB=cset_14.Set, FragmentC="*")
tmatch = MatchText(Text=blockexplode.BlockName, Pattern=graft(concat), Case=True)
filter_9 = StreamFilter(Gate=toggle, Stream0=pshift_9, Stream1=data_32)
flip = FlipMatrix(Data=tmatch)
data_38 = Data(filter_9)
item_34 = ListItem(List=flip, Index=0, Wrap=True)  # -> Item, Item1, Item2, Item3, Item4, Item5, Item6, Item7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
explode_11 = MeshExplode(Mesh=data_38, Interpolate=False)
or = GateOr(
    A=item_34.Item,
    B=item_34.Item1,
    C=item_34.Item2,
    D=item_34.Item3,
    E=item_34.Item4,
    F=item_34.Item5,
    G=item_34.Item6,
    H=item_34.Item7,
    I=item_34.Item8,
    J=item_34.Item9,
    K=item_34.Item10,
    L=item_34.Item11,
    M=item_34.Item12,
    N=item_34.Item13,
    O=item_34.Item14,
    P=item_34.Item15,
    Q=item_34.Item16,
    R=item_34.Item17,
    S=item_34.Item18,
    T=item_34.Item19,
    U=item_34.Item20)  # -> flatten(Result)
wbedges = WeaverbirdsMeshEdges(MeshOrPolylines=explode_11)
curvepoint_10 = PointOnCurve(wbedges, parameter=0.5)
pdecon_4 = Deconstruct(Point=curvepoint_10)  # -> XComponent, YComponent, ZComponent
sort_15 = SortList(Keys=pdecon_4.ZComponent, ValuesA=wbedges)  # -> Keys, ValuesA
item_35 = ListItem(List=sort_15.ValuesA, Index=0, Wrap=True)
item_36 = ListItem(List=sort_15.ValuesA, Index=Slider(1, range=0..1), Wrap=True)
len_10 = Length(Curve=item_35)
len_11 = Length(Curve=item_36)
panel_14 = Panel("""A
B
C
D
E
F
G
H
I
J
K
L
M
N
O
P
Q
R
S
T
U
V
W
X
Y
Z""")
merge_41 = Merge(Data1=len_10, Data2=len_11)
ma = MassAddition(Input=merge_41)  # -> Result, PartialResults
number_slider_14 = Slider(1000, range=0..100000)
concat_2 = Concatenate(FragmentA="*", FragmentB="Corner", FragmentC="*")
lng_21 = ListLength(List=panel_14)
flatten_11 = FlattenTree(Tree=data_37, Path="{0}")
series_2 = Series(Start=number_slider_14, Step=number_slider_14, Count=lng_21)
concat_3 = Concatenate(FragmentA="*", FragmentB="Corner_right", FragmentC="*")
concat_4 = Concatenate(FragmentA="*", FragmentB="Corner_left", FragmentC="*")
replace_14 = ReplaceMembers(Set=flatten_11, Find=panel_14, Replace=series_2)
number_slider_15 = Slider(200, range=0..1000000)
number_slider_16 = Slider(100, range=0..100000)
merge_42 = Merge(Data1=Slider(0, range=0..1), Data2=Slider(-1, range=-1..0))
merge_43 = Merge(Data1=number_slider_16, Data2=number_slider_15)
pt_3 = ConstructPoint(XCoordinate=0, YCoordinate=0, ZCoordinate=0)
data_39 = Data(flatten(prot_2))
data_40 = Data(flatten(filter_9))
bbox = BoundingBox(Content=graft(data_40), Plane=graft(data_39))  # -> simplify(Box), Box_2
data_41 = Data(simplify(graft(prot_2)))
debrep_3 = DeconstructBrep(Brep=bbox.Box)  # -> Faces, Edges, Vertices
match_8 = MatchTree(Tree=data_41, Guide=debrep_3.Faces)
tsort_5 = SortText(Keys=match_8, Values=debrep_3.Faces, Culture=127)  # -> Keys, Values
item_37 = ListItem(List=tsort_5.Values, Index=Slider(-1, range=-1..0), Wrap=True)  # -> simplify(Item)
debrep_4 = DeconstructBrep(Brep=item_37)  # -> Faces, Edges, Vertices
curvepoint_11 = PointOnCurve(debrep_4.Edges, parameter=0.5)
pdecon_5 = Deconstruct(Point=curvepoint_11)  # -> XComponent, YComponent, ZComponent
sort_16 = SortList(Keys=pdecon_5.ZComponent, ValuesA=debrep_4.Edges)  # -> Keys, ValuesA
item_38 = ListItem(List=sort_16.ValuesA, Index=Slider(2, range=0..10), Wrap=True)
item_39 = ListItem(List=sort_16.ValuesA, Index=0, Wrap=True)
len_12 = Length(Curve=item_38)  # -> flatten(Length)
len_13 = Length(Curve=item_39)  # -> flatten(Length)
round_2_decimal = Round2Decimal(L=len_12)
round_2_decimal_2 = Round2Decimal(L=len_13)
createatts = CreateAttributes(GroupIndices=Toggle(True), enableFullPath=False)

# ---- group: Get Correct Family
cull_5 = CullPattern(List=blockexplode.BlockName, CullPattern=or)
cull_6 = CullPattern(List=blockexplode.BoundingBox, CullPattern=or)

# ---- group: Unique ID without Type
pshift_24 = ShiftPaths(Data=ma.Result, Offset=-1)

# ----
tsort_6 = SortText(Keys=cull_5, Values=cull_6, Culture=127)  # -> Keys, Values
data_42 = Data(tsort_6.Values)
data_43 = Data(tsort_6.Keys)
tmatch_2 = MatchText(Text=data_43, Pattern=graft(concat_2), Case=True)
cull_7 = CullPattern(List=data_43, CullPattern=invert(tmatch_2))
cull_8 = CullPattern(List=data_42, CullPattern=invert(tmatch_2))
filter_10 = StreamFilter(Gate=toggle, Stream0=cull_8, Stream1=data_42)
data_44 = Data(flatten(pshift_24))
tmatch_3 = MatchText(Text=data_43, Pattern=graft(concat_3), Case=True)
tmatch_4 = MatchText(Text=data_43, Pattern=graft(concat_4), Case=True)
data_45 = Data(filter_10)
debox = DeconstructBox(Box=data_45)  # -> Plane, X, Y, Z
round_2_decimal_3 = Round2Decimal(L=data_44)
dedomain = DeconstructDomain(Domain=debox.X)  # -> Start, End
dedomain_2 = DeconstructDomain(Domain=debox.Y)  # -> Start, End
abs = Absolute(Value=dedomain.Start)
abs_2 = Absolute(Value=dedomain_2.Start)
addition_2 = Addition(A=abs, B=dedomain.End)
addition_3 = Addition(A=abs_2, B=dedomain_2.End)
flatten_12 = FlattenTree(Tree=round_2_decimal_3, Path="{0}")
roundd = RoundToDecimalPlace(NumberX=addition_2, DecimalPlace=2, RoundType=0)  # -> Rounded, Difference
roundd_2 = RoundToDecimalPlace(NumberX=addition_3, DecimalPlace=2, RoundType=0)  # -> Rounded, Difference
addition_4 = Addition(A=graft(replace_14), B=graft(flatten_12))
filter_11 = StreamFilter(Gate=toggle, Stream0=cull_7, Stream1=data_43)
merge_44 = Merge(Data1=graft(roundd.Rounded), Data2=graft(roundd_2.Rounded))
data_46 = Data(filter_11)
ma_2 = MassAddition(Input=merge_44)  # -> flatten(Result), PartialResults
chars_4 = Characters(Text=data_46)  # -> Result, Unicode
round_2_decimal_4 = Round2Decimal(L=ma_2.Result)
item_40 = ListItem(List=chars_4.Result, Index=0, Wrap=True)  # -> flatten(Item)
replace_15 = ReplaceMembers(Set=item_40, Find=panel_14, Replace=series_2)
addition_5 = Addition(A=graft(round_2_decimal_4), B=graft(replace_15))  # -> flatten(Result)
data_47 = Data(addition_5)
sift_9 = SiftPattern(List=data_47, SiftPattern=tmatch_4)  # -> Output0, Output1
addition_6 = Addition(A=sift_9.Output1, B=number_slider_16)
data_48 = Data(sift_9.Output0)
combine_5 = CombineData(Input0=data_48, Input1=addition_6)  # -> Result, Index
filter_12 = StreamFilter(Gate=toggle, Stream0=data_47, Stream1=combine_5.Result)
data_49 = Data(flatten(data_45))
data_50 = Data(flatten(data_46))
data_51 = Data(filter_12)
sift_10 = SiftPattern(List=data_51, SiftPattern=tmatch_3)  # -> Output0, Output1
addition_7 = Addition(A=sift_10.Output1, B=number_slider_15)
data_52 = Data(sift_10.Output0)
combine_6 = CombineData(Input0=data_52, Input1=addition_7)  # -> Result, Index
filter_13 = StreamFilter(Gate=toggle, Stream0=data_51, Stream1=combine_6.Result)
round_2_decimal_5 = Round2Decimal(L=filter_13)
data_53 = Data(round_2_decimal_5)
num_3 = Number(data_53)

# ---- group: Unique ID with Type all meshes
unflatten_16 = UnflattenTree(Tree=addition_4, Guide=pshift_24)  # -> flatten(Tree)

# ----
# Colourize Mesh Types
data_54 = Data(flatten(data_37))
cset_15 = CreateSet(List=data_54)  # -> Set, Map
lng_22 = ListLength(List=cset_15.Set)
lng_23 = ListLength(List=cset_15.Set)
series_3 = Series(Start=Slider(0, range=0..100), Step=Slider(1, range=0..1), Count=lng_22)
data_55 = Data(lng_23)
data_56 = Data(data_54)
dom_3 = ConstructDomain(DomainStart=Slider(0, range=0..150), DomainEnd=Slider(255, range=0..1000))
replace_16 = ReplaceMembers(Set=data_56, Find=cset_15.Set, Replace=series_3)
div_4 = DivideDomain(Domain=dom_3, Count=data_55)
dedomain_3 = DeconstructDomain(Domain=div_4)  # -> Start, End
number_slider_17 = Slider(255, range=0..1000)
bnd_6 = Bounds(Numbers=replace_16)
data_57 = Data(list_6)
div_5 = DivideDomain(Domain=bnd_6, Count=data_55)
equals_3 = Equality(FirstNumber=data_57, SecondNumber=Slider(7, range=0..10))  # -> Equality, Inequality
rgb = ColourRGB(Alpha=255, Red=number_slider_17, Green=number_slider_17, Blue=0)
rgb_2 = ColourRGB(Alpha=255, Red=Slider(255, range=0..1000), Green=0, Blue=0)
rgb_3 = ColourRGB(Alpha=255, Red=0, Green=Slider(255, range=0..1000), Blue=0)
rgb_4 = ColourRGB(Alpha=255, Red=0, Green=0, Blue=Slider(255, range=0..1000))
rgb_5 = ColourRGB(Alpha=255, Red=dedomain_3.End, Green=0, Blue=dedomain_3.End)
range_5 = Range(Domain=data_55, Steps=data_55)
merge_45 = Merge(Data1=rgb, Data2=rgb_2, Data3=rgb_3, Data4=rgb_4)
fdom_4 = FindDomain(Domains=div_5, Number=replace_16, Strict=False)  # -> Index, Neighbour
filter_14 = StreamFilter(Gate=equals_3.Equality, Stream0=rgb_5, Stream1=merge_45)
cull_i_3 = CullIndex(List=range_5, Indices=Slider(-1, range=-1..0), Wrap=True)
num_4 = Number(fdom_4.Index)
data_58 = Data(data_37)
gate_24 = StreamGate(Stream=prot_2, Gate=replace)  # -> Target0, flatten(Target1)
panel_15 = Panel("""North
East
South
West""")
replace_17 = ReplaceMembers(Set=num_4, Find=cull_i_3, Replace=filter_14)
mcol = MeshColours(Mesh=simplify(graft(pshift_9)), Colours=simplify(graft(replace_17)))
gate_25 = StreamGate(Stream=mcol, Gate=replace)  # -> Target0, flatten(Target1)
filter_15 = StreamFilter(
    Gate=equals_3.Equality,
    Stream0=ColourSwatch(SwatchColor=RGB(255, 255, 255)),
    Stream1=ColourSwatch(SwatchColor=RGB(10, 10, 10)))
preview = CustomPreview(Geometry=gate_25.Target1, Material=ColourSwatch(SwatchColor=RGB(0, 0, 0)))

gate_26 = StreamGate(Stream=data_58, Gate=replace)  # -> Target0, flatten(Target1)

# ---- group: Preview
data_59 = Data(gate_25.Target1)

# ----
cset_16 = CreateSet(List=flatten(gate_26.Target1))  # -> Set, Map
tsort_7 = SortText(Keys=cset_16.Set, Culture=127)  # -> Keys, Values
replace_18 = ReplaceMembers(Set=gate_26.Target1, Find=tsort_7.Keys, Replace=panel_15)
concat_5 = Concatenate(FragmentA=gate_26.Target1, FragmentB=replace_18)
filter_16 = StreamFilter(Gate=equals_3.Equality, Stream0=data_37, Stream1=concat_5)  # -> flatten(Stream)
faceb = FaceBoundaries(Mesh=data_59)
justified_text = JustifiedText3d(
    Location=gate_24.Target1,
    Text=flatten(filter_16),
    Size=Slider(0.6919, range=0..1),
    Color=filter_15,
    HorizontalAlignment=1,
    VerticalAlginment=Slider(2, range=0..10),
    UseMeshes=False,
    Bake=False)
previewlw = CustomPreviewLineweights(Geometry=faceb, Shader=ColourSwatch(SwatchColor=RGB(0, 0, 0)), Thickness=Slider(2, range=0..10), Absolute=False)

# ----
# Colourize Heights
number_slider_18 = Slider(4, range=0..10)
wbedges_2 = WeaverbirdsMeshEdges(MeshOrPolylines=pshift_9)
partition = PartitionList(List=wbedges_2, Size=number_slider_18)
curvepoint_12 = PointOnCurve(partition, parameter=0.5)
pdecon_6 = Deconstruct(Point=curvepoint_12)  # -> XComponent, YComponent, ZComponent
sort_17 = SortList(Keys=pdecon_6.ZComponent, ValuesA=partition)  # -> Keys, ValuesA
item_41 = ListItem(List=sort_17.ValuesA, Index=Slider(1, range=0..1), Wrap=True)  # -> flatten(Item)
len_14 = Length(Curve=item_41)
round_2_decimal_6 = Round2Decimal(L=len_14)
data_60 = Data(round_2_decimal_6)
cset_17 = CreateSet(List=data_60)  # -> Set, Map
lng_24 = ListLength(List=cset_17.Set)
div_6 = DivideDomain(Domain=Slider(225, range=0..1000), Count=lng_24)
dedomain_4 = DeconstructDomain(Domain=div_6)  # -> Start, flatten(End)
rgb_6 = ColourRGB(Alpha=255, Red=0, Green=dedomain_4.End, Blue=dedomain_4.End)  # -> flatten(Colour)
replace_19 = ReplaceMembers(Set=data_60, Find=cset_17.Set, Replace=rgb_6)
mcol_2 = MeshColours(Mesh=simplify(graft(pshift_9)), Colours=simplify(graft(replace_19)))
gate_27 = StreamGate(Stream=mcol_2, Gate=replace_2)  # -> Target0, flatten(Target1)
gate_28 = StreamGate(Stream=prot_2, Gate=replace_2)  # -> Target0, flatten(Target1)
data_61 = Data(flatten(round_2_decimal_6))
justified_text_2 = JustifiedText3d(
    Location=gate_28.Target1,
    Text=data_61,
    Size=Slider(0.6919, range=0..1),
    Color=ColourSwatch(SwatchColor=RGB(255, 255, 255)),
    HorizontalAlignment=1,
    VerticalAlginment=Slider(2, range=0..10),
    UseMeshes=False,
    Bake=False)
preview_2 = CustomPreview(Geometry=gate_27.Target1, Material=ColourSwatch(SwatchColor=RGB(0, 0, 0)))

# ---- group: Preview
data_62 = Data(gate_27.Target1)

# ----
faceb_2 = FaceBoundaries(Mesh=data_62)
previewlw_2 = CustomPreviewLineweights(Geometry=faceb_2, Shader=ColourSwatch(SwatchColor=RGB(0, 0, 0)), Thickness=Slider(2, range=0..10), Absolute=False)

# ----
# Mesh Accuracy Anaylsis
number_slider_19 = Slider(0, range=0..1)
item_42 = ListItem(List=sort_17.ValuesA, Index=number_slider_19, Wrap=True)  # -> flatten(Item)
len_15 = Length(Curve=item_42)
round_2_decimal_7 = Round2Decimal(L=len_15)
data_63 = Data(flatten(round_2_decimal_7))
nullrep_3 = ReplaceNulls(Items=data_63, Replacements=Slider(0, range=0..100))  # -> Items, Count
cset_18 = CreateSet(List=nullrep_3.Items)  # -> Set, Map
sort_18 = SortList(Keys=cset_18.Set)  # -> Keys, ValuesA
rgb_7 = ColourRGB(Alpha=255, Red=Slider(225, range=0..1000), Green=0, Blue=0)  # -> flatten(Colour)
rgb_8 = ColourRGB(Alpha=255, Red=0, Green=Slider(225, range=0..1000), Blue=0)  # -> flatten(Colour)
round_2_decimal_8 = Round2Decimal(L=sort_18.Keys)
merge_46 = Merge(Data1=Toggle(True), Data2=Toggle(False))
merge_47 = Merge(Data1=rgb_8, Data2=rgb_7)
panel_16 = Panel(round_2_decimal_8)
equals_4 = Equality(FirstNumber=panel_16, SecondNumber=panel_target_width)  # -> Equality, Inequality
replace_20 = ReplaceMembers(Set=equals_4.Equality, Find=merge_46, Replace=merge_47)
panel_17 = Panel(replace_20)
replace_21 = ReplaceMembers(Set=nullrep_3.Items, Find=panel_16, Replace=panel_17)
mcol_3 = MeshColours(Mesh=simplify(graft(pshift_9)), Colours=simplify(graft(replace_21)))
gate_29 = StreamGate(Stream=mcol_3, Gate=replace_3)  # -> Target0, Target1
demesh_2 = DeconstructMesh(Mesh=gate_29.Target1)  # -> Vertices, Faces, Colours, Normals
item_43 = ListItem(List=demesh_2.Vertices, Index=0, Wrap=True)  # -> Item, Item1, Item2, Item3
facen_2 = FaceNormals(Mesh=gate_29.Target1)  # -> Centers, Normals
merge_48 = Merge(Data1=item_43.Item, Data2=item_43.Item2)
neg_8 = Negative(Value=Slider(1.92, range=0..100))
line_6 = LineSDL(Start=merge_48, Direction=facen_2.Normals, Length=neg_8)
swatch = ColourSwatch(SwatchColor=RGB(0, 0, 0))
gate_30 = StreamGate(Stream=prot_2, Gate=replace_3)  # -> Target0, flatten(Target1)
justified_text_3 = JustifiedText3d(
    Location=gate_30.Target1,
    Text=data_63,
    Size=Slider(0.6919, range=0..1),
    Color=ColourSwatch(SwatchColor=RGB(255, 255, 255)),
    HorizontalAlignment=1,
    VerticalAlginment=Slider(2, range=0..10),
    UseMeshes=False,
    Bake=False)
preview_3 = CustomPreview(Geometry=gate_29.Target1, Material=ColourSwatch(SwatchColor=RGB(0, 0, 0)))
preview_4 = CustomPreview(Geometry=line_6, Material=swatch)
vdisex = VectorDisplayEx(Point=merge_48, Vector=line_6, Colour=swatch, Width=Slider(0.75109, range=0..1))

# ---- group: Preview
data_64 = Data(gate_29.Target1)

# ----
faceb_3 = FaceBoundaries(Mesh=data_64)
previewlw_3 = CustomPreviewLineweights(Geometry=faceb_3, Shader=ColourSwatch(SwatchColor=RGB(0, 0, 0)), Thickness=Slider(2, range=0..10), Absolute=False)

unflatten_17 = UnflattenTree(Tree=unflatten_16, Guide=explode_8)
item_44 = ListItem(List=unflatten_17, Index=merge_42, Wrap=True)
cull_i_4 = CullIndex(List=unflatten_17, Indices=merge_42, Wrap=True)  # -> simplify(List)
addition_8 = Addition(A=item_44, B=merge_43)  # -> simplify(Result)
item_45 = ListItem(List=addition_8, Index=0, Wrap=True)  # -> Item, Item1
merge_49 = Merge(Data1=item_45.Item, Data2=cull_i_4, Data3=item_45.Item1)

# ---- group: Unique ID with Corner Blocks
unflatten_18 = UnflattenTree(Tree=merge_49, Guide=unflatten_16)

# ----
filter_17 = StreamFilter(Gate=toggle, Stream0=unflatten_16, Stream1=unflatten_18)
cset_19 = CreateSet(List=filter_17)  # -> Set, Map
tsort_8 = SortText(Keys=cset_19.Set, Culture=127)  # -> Keys, Values
round_2_decimal_9 = Round2Decimal(L=filter_17)
data_65 = Data(tsort_8.Keys)
num_5 = Number(data_65)
num_6 = Number(round_2_decimal_9)

# ---- group: Find Nearest Value
python_4 = GhPythonScript(lst=num_3, y=num_5)  # -> flatten(out), a; inputs lst: list; same code as python_3

python_5 = GhPythonScript(lst=num_3, y=num_6)  # -> flatten(out), a; inputs lst: list; same code as python_3

# ----
round_2_decimal_10 = Round2Decimal(L=python_5.out)
round_2_decimal_11 = Round2Decimal(L=python_4.out)
mindex_5 = MemberIndex(Set=data_53, Member=round_2_decimal_11)  # -> Index, Count
item_46 = ListItem(List=mindex_5.Index, Index=0, Wrap=True)  # -> flatten(Item)
item_47 = ListItem(List=data_50, Index=item_46, Wrap=True)
item_48 = ListItem(List=data_49, Index=item_46, Wrap=True)
lng_25 = ListLength(List=round_2_decimal_11)
mindex_6 = MemberIndex(Set=round_2_decimal_10, Member=round_2_decimal_11)  # -> simplify(Index), Count
graft_4 = GraftTree(Tree=item_48, IncludeEmptyLists=True, IncludeNullItems=True)  # -> simplify(Tree)
lng_26 = ListLength(List=mindex_6.Index)
repeat_7 = RepeatData(Data=pt_3, Length=lng_25)
repeat_8 = RepeatData(Data=graft_4, Length=lng_26)  # -> simplify(Data)
replace_22 = ReplaceMembers(Set=round_2_decimal_10, Find=round_2_decimal_11, Replace=repeat_7)
replace_23 = ReplaceItems(List=replace_22, Item=flatten(repeat_8), Indices=flatten(mindex_6.Index), Wrap=False)  # -> simplify(flatten(List))
replace_24 = ReplaceMembers(Set=round_2_decimal_10, Find=round_2_decimal_11, Replace=item_47)
unflatten_19 = UnflattenTree(Tree=replace_23, Guide=filter_9)
unflatten_20 = UnflattenTree(Tree=replace_24, Guide=filter_9)
unflatten_21 = UnflattenTree(Tree=replace_22, Guide=filter_9)
debox_2 = DeconstructBox(Box=unflatten_19)  # -> Plane, X, Y, Z
dedomain_5 = DeconstructDomain(Domain=debox_2.X)  # -> Start, End
dedomain_6 = DeconstructDomain(Domain=debox_2.Y)  # -> Start, End
abs_3 = Absolute(Value=dedomain_5.Start)
abs_4 = Absolute(Value=dedomain_5.End)
abs_5 = Absolute(Value=dedomain_6.Start)
abs_6 = Absolute(Value=dedomain_6.End)
merge_50 = Merge(Data1=graft(abs_3), Data2=graft(abs_4))
merge_51 = Merge(Data1=graft(abs_5), Data2=graft(abs_6))
ma_3 = MassAddition(Input=merge_50)  # -> flatten(Result), PartialResults
ma_4 = MassAddition(Input=merge_51)  # -> flatten(Result), PartialResults
orient = Orient(Geometry=unflatten_19, Source=unflatten_21, Target=prot_2)  # -> Geometry, Transform
round_2_decimal_12 = Round2Decimal(L=ma_3.Result)
round_2_decimal_13 = Round2Decimal(L=ma_4.Result)
division_7 = Division(A=round_2_decimal_2, B=round_2_decimal_12)
division_8 = Division(A=round_2_decimal, B=round_2_decimal_13)
area_3 = Area(Geometry=orient.Geometry)  # -> Area, Centroid
unflatten_22 = UnflattenTree(Tree=division_8, Guide=filter_9)
unflatten_23 = UnflattenTree(Tree=division_7, Guide=filter_9)
viewer_5 = ParamViewer(area_3.Centroid)
filter_18 = StreamFilter(Gate=Toggle(True), Stream0=Slider(1, range=0..1), Stream1=unflatten_23)
filter_19 = StreamFilter(Gate=toggle_2, Stream0=Slider(1, range=0..1), Stream1=unflatten_22)
flatten_13 = FlattenTree(Tree=orient.Transform, Path="{0}")

# ---- group: Display Blocks in Use
tsort_9 = SortText(Keys=item_47, Culture=127)  # -> Keys, Values
cset_20 = CreateSet(List=tsort_9.Keys)  # -> Set, Map

# ----
# Blocks In Use
blocks_in_use = Panel(cset_20.Set)

# ---- group: Bounding Box Representation
scale_nu = ScaleNU(Geometry=orient.Geometry, Plane=prot_2, ScaleX=filter_18, ScaleY=filter_19, ScaleZ=1)  # -> Geometry, Transform

# ----
flatten_14 = FlattenTree(Tree=scale_nu.Transform, Path="{0}")
merge_52 = Merge(Data1=graft(flatten_13), Data2=graft(flatten_14))
comp = Compound(Transforms=merge_52)
unflatten_24 = UnflattenTree(Tree=comp, Guide=scale_nu.Transform)
placeblock = PlaceBlock(BlockName=unflatten_20, Transform=unflatten_24, Bake=button, Attributes=createatts)

# ==== cluster SortSurfaces
B = ClusterInput()
debrep = DeconstructBrep(Brep=B)  # -> Faces, Edges, Vertices
area = Area(Geometry=debrep.Faces)  # -> Area, Centroid
srf_cp = SurfaceClosestPoint(Point=area.Centroid, Surface=debrep.Faces)  # -> Point, UVPoint, Distance
custom_order = ClusterInput()
evalsrf = EvaluateSurface(Surface=debrep.Faces, Point=srf_cp.UVPoint)  # -> Point, Normal, UDirection, VDirection, Frame
pdecon = Deconstruct(Point=evalsrf.Point)  # -> XComponent, YComponent, ZComponent
sort = SortList(Keys=pdecon.ZComponent, ValuesA=debrep.Faces)  # -> Keys, ValuesA
merge = Merge(Data1=Slider(-1, range=-1..0), Data2=Slider(0, range=0..100))
item = ListItem(List=sort.ValuesA, Index=Slider(-1, range=-1..0), Wrap=True)
item_2 = ListItem(List=sort.ValuesA, Index=0, Wrap=True)
cull_i = CullIndex(List=sort.ValuesA, Indices=merge, Wrap=True)
item_3 = ListItem(List=sort.ValuesA, Index=custom_order, Wrap=True)
join = BrepJoin(Breps=cull_i)  # -> Breps, Closed
custom = Data(item_3)
lowest = Data(item_2)
highest = Data(item)
custom_2 = ClusterOutput(custom)
remove_cap = Data(join.Breps)
lowest_2 = ClusterOutput(lowest)
highest_2 = ClusterOutput(highest)
remove_cap_2 = ClusterOutput(remove_cap)

# ==== cluster Round2Decimal
before = Slider(1, range=0..5)
after = Slider(2, range=0..5)
L = ClusterInput()
ghpython_script = GhPythonScript(active=Toggle(True), L=L, before=before, after=after)  # -> out, simplify(flatten(R)), active; inputs L: list, before: Int32, after: Int32
# ---------- ghpython_script: Python ----------
if active:

    L = [(eval("'{:0" + str(before+after+1) + "." + str(after) +"f}'.format(float(" + str(num) + "))")) for num in L]

    R = L

    active = True
else:
    active = False
# ---------- end ghpython_script ----------
R = ClusterOutput(ghpython_script.R)
